# Requirement set Requirements_Client (R2023b)

## 1 [Client_01] Type Vehicle
The develop vehicle must have 4 wheels

## 2 [Client_02] Electric_car
Vehicle must be electric and use a bateries cell

## 3 [Client_03] Spped vehicle
The vehicle shall reach a speed of 30 km/h

## 4 [Client_04] Dimension
The vehicle must have standard measurements of a radio-controlled car, comfortable to transport

## 5 [Client_05] Vision_first_person
The vehicle shall incomporate a camera to transmit video to station control

## 6 [Client_06] Control_vehicle
The vehicle must be driven using a steering wheel connected to a PC